# Grasshopper definition exercise_001b.gh (Grasshopper 1.0.7)

number_slider = Slider(30, range=0..30)
division = Division(A=number_slider, B=number_slider)
division_2 = Division(A=number_slider, B="2")
# e^(pi*i) = -1
panel = Panel("e^(pi*i) = -1")
negative = Negative(Value=division_2)
division_3 = Division(A=division, B="2")
series = Series(Start=negative, Step=division, Count=number_slider)
unit_y = UnitY(Factor=division_3)
construct_point = ConstructPoint(XCoordinate=series, YCoordinate=0, ZCoordinate=0)
negative_2 = Negative(Value=unit_y)
list_length = ListLength(List=construct_point)
move = Move(Geometry=construct_point, Motion=graft([negative_2, unit_y]))  # -> Geometry, Transform
division_4 = Division(A=list_length, B="2")
number_slider_2 = Slider(0.61, range=0..1)
flip_matrix = FlipMatrix(Data=move.Geometry)
unit_y_2 = UnitY(Factor=Slider(0.35, range=0..1))
dispatch = Dispatch(List=flip_matrix, DispatchPattern=[True, False])  # -> ListA, ListB
division_5 = Division(A=number_slider_2, B="2")
negative_3 = Negative(Value=unit_y_2)
polyline = PolyLine(Vertices=construct_point, Closed=False)
circle = Circle(Plane=move.Geometry, Radius=division_5)
line = Line(StartPoint=dispatch.ListA, EndPoint=dispatch.ListB)
point = Point(dispatch.ListA)
list_item = ListItem(List=construct_point, Index=division_4, Wrap=True)
move_2 = Move(Geometry=point, Motion=negative_3)  # -> Geometry, Transform
circle_2 = Circle(Plane=list_item, Radius=number_slider_2)
number_slider_3 = Slider(0.09, range=0..1)
boundary_surfaces = BoundarySurfaces(Edges=circle_2)
offset_curve = OffsetCurve(Curve=line, Distance=number_slider_3, Corners=1)
offset_curve_2 = OffsetCurve(Curve=polyline, Distance=number_slider_3, Corners=1)
area = Area(Geometry=boundary_surfaces)  # -> Area, Centroid
curve = Curve(graft(line))
curve_2 = Curve(graft(polyline))
loft = Loft(
    Curves=[curve, offset_curve],
    Options={Adjust=False, Closed=False, LoftEnds=0, LoftSimp=0, LoftType=0, Rebuild=10, Refit=0.01})
loft_2 = Loft(
    Curves=[curve_2, offset_curve_2],
    Options={Adjust=False, Closed=False, LoftEnds=0, LoftSimp=0, LoftType=0, Rebuild=10, Refit=0.01})
number_slider_4 = Slider(1.84, range=0..3)
merge = Merge(Data1=polyline, Data2=[loft, loft_2], Data3=construct_point, Data4=move.Geometry)
scale_nu = ScaleNU(Geometry=merge, Plane=PlaneXY(0, 0, 0), ScaleX=number_slider_4, ScaleY=number_slider_4, ScaleZ=1)  # -> Geometry, Transform
pi = Pi(Factor=Slider(0.16, range=0..2))
rotate_3d = Rotate3D(Geometry=scale_nu.Geometry, Angle=pi, Center=Point(0, 0, 0), Axis=Vector(0, 0, 1))  # -> Geometry, Transform
text_tag_3d = TextTag3D(Location=flatten(move_2.Geometry), Text=series, Size=number_slider_2, Justification=2)
panel_2 = Panel("0")
